# Requirement set MissDetector_requirementSet (R2024a)

## 1 [#1] فعال شدن سیگنال missed
اگر در فاصله زمانی بین کلاک اول تا دوم، سیگنال سنسور دریافت نشد، سیگنال missed ارسال شود

## 2 [#2] فعال شدن سیگنال ok
اگر همزمان با کلاک اول یا تا قبل از کلاک دوم سیگنال سنسور دریافت شد، سیگنال ok فعال شود

## 3 [#3] انتظار کلاک دوم
زمانی که کلاک اول دیده شد، سیستم باید در وضعیت انتظار برای دیدن کلاک دوم قرار بگیرد