# Requirement set StatusClassifier_requirementSet (R2024a)

## 1 [#1] انتقال به وضعیت هشدار
اگر تعداد سیگنال‌های متوالی missed بیشتر از مقدار آستانه شد، سیستم باید در وضعیت هشدار قرار بگیرد

## 2 [#2] انتقال به وضعیت عادی
اگر تعداد سیگنال‌های متوالی ok بیشتر از مقدار آستانه شد، سیستم باید در وضعیت عادی قرار بگیرد

## 3 [#3] ریست شدن سیگنال‌های missed متوالی
اگر سیستم در وضعیت عادی باشد، به محض دریافت یک سیگنال ok باید توالی محاسبات تعداد سیگنال‌های missed ریست شود و از صفر شمارش را آغاز کند

## 4 [#4] ریست شدن سیگنال‌های ok متوالی
اگر سیستم در وضعیت هشدار باشد، به محض دریافت یک سیگنال misssed باید توالی محاسبات تعداد سیگنال‌های ok ریست شود و از صفر شمارش را آغاز کند

## 5 [#6] شمارش سیگنال‌های ok
سیستم در وضعیت هشدار باید تعداد سیگنال‌های ok متوالی را شمارش کند

## 6 [#5] شمارش سیگنال‌های missed
سیستم در وضعیت عادی باید تعداد سیگنال‌های missed متوالی را شمارش کند