test file "model_test"
  coverage: Decision

suite "Test Suite 1"

  case "test_start_on" [baseline]
    model ex4_statecart, harness ex4_statecart_Harness1 (for ex4_statecart/Chart1)
    input "test_on.mat", mapped to dec, inc, t_on, t_off, stop, start (active)
    baseline "baseline_test_on.mat"
      vol1:1
      vol2:1
      off:1
      on:1
      shut:1

  case "test_start_on_off_shut" [baseline]
    model ex4_statecart, harness ex4_statecart_Harness1 (for ex4_statecart/Chart1)
    input "test_on_off.mat", mapped to dec, inc, t_on, t_off, stop, start (active)
    baseline "baseline_test_on_off.mat"
      vol1:1
      vol2:1
      off:1
      on:1
      shut:1

  case "test_start_dec_inc_shut" [baseline]
    model ex4_statecart, harness ex4_statecart_Harness1 (for ex4_statecart/Chart1)
    input "test_inc_dec.mat", mapped to dec, inc, t_on, t_off, stop, start (active)
    baseline "baseline_test_inc_dec.mat"
      vol1:1
      vol2:1
      off:1
      on:1
      shut:1

  case "test_on" [baseline]
    model ex4_statecart, harness ex4_statecart_Harness1 (for ex4_statecart/Chart1)
    input "test_on.mat", mapped to dec, inc, t_on, t_off, stop, start (active)
    baseline "baseline_test_on.mat"
      vol1:1
      vol2:1
      off:1
      on:1
      shut:1

  case "test_start_on_inc_shut" [baseline]
    model ex4_statecart, harness ex4_statecart_Harness1 (for ex4_statecart/Chart1)
    input "test_start_on_inc.mat", mapped to dec, inc, t_on, t_off, stop, start (active)
    baseline "baseline_test_start_on_dec.mat"
      vol1:1
      vol2:1
      off:1
      on:1
      shut:1